# Grasshopper definition api.ghx (Grasshopper 1.0.7)
# plug-ins: Hops

application_json = Panel("{\"kwargs\":{\"key\": \"all\",\"num\": 1000.0}}")
local_hops = Panel("http://localhost:5000/")
# deploy app: http://mmodel.contextmachine.online:8088/
# deploy hops: http://mmodel.contextmachine.online:5000/
local_app = Panel("http://localhost:8080/")
concat = Concatenate(FragmentC=local_app, FragmentA="site/kommunarka/")
concat_2 = Concatenate(FragmentC=local_app, FragmentA="site/kommunarka/")
hops = Hops(
    Run=Toggle(True),
    Url=concat,
    Name="polygon_coords",
    CacheResultsInMemory=False,
    CacheSolveResults=False,
    RemoteDefinitionLocation="http://127.0.0.1:5000/GET",
    RemoteSolveVersion=(0, 1, 0),
    ShowInput_Enabled=False,
    ShowInput_Path=False,
    SynchronousSolve=True)
hops_2 = Hops(
    Run=Toggle(True),
    Url=concat,
    Name="network_edges_coords",
    Data=application_json,
    CacheResultsInMemory=False,
    CacheSolveResults=False,
    RemoteDefinitionLocation="http://127.0.0.1:5000/POST",
    RemoteSolveVersion=(0, 1, 0),
    ShowInput_Enabled=False,
    ShowInput_Path=False,
    SynchronousSolve=False)
panel = Panel(hops)
python = GhPythonScript(x=hops_2, y="network_edges_coords")  # -> out, a
# ---------- python: Python ----------
__author__ = "andrewastakhov"
import json

import rhinoscriptsyntax as rs
from Rhino.Geometry import Point3d, Polyline
from ghpythonlib.treehelpers import list_to_tree
def decode_pts(arr):
    for pt in arr:
        pt.append(0.0)
        yield Point3d(*pt)

def decode_lines(arr):
    for ln in arr:
        yield Polyline(list(decode_pts(ln)))


a = list_to_tree(
    list(
        decode_lines(
            json.loads(x)[y]
        )
    )
)
# ---------- end python ----------
python_2 = GhPythonScript(x=hops, y="polygon_coords")  # -> out, a
# ---------- python_2: Python ----------
__author__ = "andrewastakhov"
import json

import rhinoscriptsyntax as rs
from Rhino.Geometry import Point2d
from ghpythonlib.treehelpers import list_to_tree

def decode_pts(arr):
    for pt in arr:
        yield Point2d(*pt)


a = list_to_tree(
    list(
        decode_pts(
            json.loads(x)[y]
        )
    )
)
# ---------- end python_2 ----------
pt = Point(python_2.a)
pline = PolyLine(Vertices=python.a, Closed=False)
pline_2 = PolyLine(Vertices=pt, Closed=False)
cpoly = ControlPolygon()  # -> Polygon, Points
number_slider = Slider(0.99, range=0..1)
genes = GenePool(Decimals=5, Maximum=1, Minimum=0, Value=[0.18634, 0.27118, 0.38422, 0.50287])
pt_2 = Point([<point referenced from the Rhino model> x4])
vlen = VectorLength()
pt_3 = ConstructPoint(XCoordinate=Slider(0.6, range=0..1), YCoordinate=Slider(0.4, range=0..1), ZCoordinate=0)
sort = SortList()  # -> Keys, ValuesA
number_slider_2 = Slider(0.5, range=0..1)
number_slider_3 = Slider(1, range=0..1)
hops_3 = Hops(
    Pts=pt,
    Run=True,
    CacheResultsInMemory=False,
    CacheSolveResults=False,
    RemoteDefinitionLocation="https://deephops.herokuapp.com/base_min_bound_rect ",
    RemoteSolveVersion=(0, 1, 0),
    ShowInput_Enabled=False,
    ShowInput_Path=False,
    SynchronousSolve=False)  # -> Out, A_pt_out
shatter = Shatter(Parameters=genes)
sort_2 = SortList(Keys=genes)  # -> Keys, ValuesA
one_over_x = OneOverX(Value=Slider(1, range=0..1))
pline_3 = PolyLine(Vertices=hops_3.A_pt_out, Closed=False)
B = Bounds({Plane=PlaneXY(0.5, 0.5, 0), Size=Domain2(u=-0.5..0.5, v=-0.5..0.5)})
pt2num = PointsToNumbers(Points=graft(pt_2), Mask=4)
hops_4 = Hops(
    CacheResultsInMemory=True,
    CacheSolveResults=True,
    RemoteSolveVersion=(0, 1, 0),
    ShowInput_Enabled=False,
    ShowInput_Path=False,
    SynchronousSolve=True)
neg = Negative(Value=Slider(1, range=0..10))
python_3 = GhPythonScript(x=sort_2.Keys, y=neg)  # -> out, a; inputs x: list, y: Int32
# ---------- python_3: Python ----------
__author__ = "andrewastakhov"

import rhinoscriptsyntax as rs
from collections import deque
from ghpythonlib.treehelpers import list_to_tree
dq = deque(x)
dq.rotate(y)
print(dq)

a = list_to_tree(zip(x, dq))
print(a)
# ---------- end python_3 ----------
X = UnitX(Factor=1)
Y = UnitY(Factor=1)
pln = Plane(pline_3)
orient = Orient(Geometry=pt_2, Source=pln, Target=PlaneXY(0, 0, 0))  # -> Geometry, Transform
orient_2 = Orient(Geometry=pline_2, Source=pln, Target=PlaneXY(0, 0, 0))  # -> Geometry, Transform
item = ListItem(List=orient.Geometry, Index=0, Wrap=True)
orient_3 = Orient(Geometry=pline, Source=pln, Target=PlaneXY(0, 0, 0))  # -> Geometry, Transform
orient_4 = Orient(Geometry=pline_3, Source=pln, Target=PlaneXY(0, 0, 0))  # -> Geometry, Transform
explode = Explode(Curve=orient_2.Geometry, Recursive=True)  # -> Segments, Vertices
lng = ListLength(List=explode.Segments)
len = Length(Curve=lng)
range = Range(Domain=Domain(0, 1), Steps=lng)
graph = GraphMapper(
    range,
    x0=0,
    x1=1,
    y0=0,
    y1=1,
    container_name="Sinc",
    Equation_X0=0,
    Equation_X1=0.3533602059,
    Equation_Y0=0,
    Equation_Y1=0.6594125032)
vlen_2 = VectorLength(Vector=explode.Segments)
crv = Curve(reparameterize(orient_2.Geometry))
cull_i = CullIndex(List=orient.Geometry, Indices=Slider(0, range=0..100), Wrap=True)
crv_cp = CurveClosestPoint(Point=orient.Geometry, Curve=crv)  # -> Point, Parameter, Distance
one_over_x_2 = OneOverX(Value=lng)
unit = UnitVector(Vector=explode.Segments)
pt_4 = Point(orient.Geometry)
pt_5 = Point(unit)
panel_2 = Panel(crv_cp.Parameter)
explode_2 = Explode(Curve=crv, Recursive=True)  # -> Segments, Vertices
pdecon = Deconstruct(Point=pt_5)  # -> XComponent, YComponent, ZComponent
vec = VectorXYZ(XComponent=pdecon.XComponent, YComponent=pdecon.YComponent, ZComponent=graph)  # -> Vector, Length
eval = EvaluateCurve(Curve=crv, Parameter=sort_2.Keys)  # -> Point, Tangent, Angle
hops_5 = Hops(
    Pts=eval.Point,
    Run=True,
    CacheResultsInMemory=False,
    CacheSolveResults=False,
    RemoteDefinitionLocation="https://deephops.herokuapp.com/base_min_bound_rect ",
    RemoteSolveVersion=(0, 1, 0),
    ShowInput_Enabled=False,
    ShowInput_Path=False,
    SynchronousSolve=False)  # -> Out, A_pt_out
pline_4 = PolyLine(Vertices=hops_5.A_pt_out, Closed=invert(False))
srf = Surface(reparameterize(simplify(pline_4)))
evalsrf = EvaluateSurface(Surface=srf, Point=pt_3)  # -> Point, Normal, UDirection, VDirection, Frame
dist = Distance(PointA=eval.Point, PointB=evalsrf.Point)
eval_2 = EvaluateCurve(Curve=crv, Parameter=python_3.a)  # -> Point, Tangent, Angle
cir = Circle(Plane=eval.Point, Radius=dist)
pt_6 = Point(vec.Vector)
lng_2 = ListLength(List=pt_6)
len_2 = Length(Curve=pt_6)
shatter_2 = Shatter(Curve=crv, Parameters=python_3.a)
ln = Line(StartPoint=cir, EndPoint=evalsrf.Point)
pt_7 = Point(Y)
pt_8 = Point(X)
len_3 = Length(Curve=shatter_2)
panel_3 = Panel(len_3)
pgroups = PointGroups(Points=pt_6, Distance=Slider(0.08894, range=0..1))  # -> Groups, Indices
pline_5 = PolyLine(Closed=False)
item_2 = ListItem(List=reverse(shatter_2), Index=0, Wrap=True)
scale = Scale(Geometry=B, Center=Point(0, 0, 0), Factor=Slider(10, range=0..10))  # -> Geometry, Transform
panel_4 = Panel("0.53")
dist_2 = Distance(PointA=pt_8, PointB=pt_7)
python_4 = GhPythonScript(x=pt_6, y=dist_2)  # -> out, a; inputs x: list of Point3d
# ---------- python_4: Python ----------
__author__ = "andrewastakhov"
from ghpythonlib.treehelpers import list_to_tree
import rhinoscriptsyntax as rs
import copy
def dd(x, y):
    for i, v in enumerate(x):
        
        mtr=[]
        
        for j, k in enumerate(x):
            d = v.DistanceTo(k)
            di = i-j
            imetric=None
            if di == 0:
                imetric=0
            else:
                imetric=abs(di)**-1
            
            print(i, j, imetric)
            
            mtr.append([d, (d/y)*imetric])
        yield mtr

a = list_to_tree(list(dd(x, y)))
# ---------- end python_4 ----------
item_3 = ListItem(List=python_4.a, Index=0, Wrap=True)  # -> flatten(Item), Item1
matrix = ConstructMatrix(Rows=lng_2, Columns=lng_2, Values=item_3.Item)
lng_3 = ListLength(List=item_3.Item)
sqrt = SquareRoot(Value=lng_3)
python_5 = GhPythonScript()  # -> out, a; unedited script template
sort_3 = SortList(Keys=len_3, ValuesA=shatter_2)  # -> Keys, ValuesA
lng_4 = ListLength(List=pgroups.Groups)  # -> flatten(Length)
group = Group()
genes_2 = GenePool(Decimals=2, Maximum=1000, Minimum=500, Value=[986.65, 648.85, 879.33, 665.44])
pt_9 = Point()
rec = Rectangle({Plane=PlaneXY(32.5, 32.5, 0), Size=Domain2(u=-32.5..32.5, v=-32.5..32.5)})
item_4 = ListItem(List=sort_3.ValuesA, Index=0, Wrap=True)
cp = ControlPoints(Curve=item_4)  # -> Points, Weights, Knots
panel_5 = Panel(python_3.a)
bang = ExplodeTree(Data=item_2)  # -> Branch0, Branch1, Branch2, Branch3
python_6 = GhPythonScript(x=pgroups.Indices, y=pgroups.Groups)  # -> out, a; inputs x: list, y: list
# ---------- python_6: Python ----------
__author__ = "andrewastakhov"

import rhinoscriptsyntax as rs



class WrapperC:
    def __init__(self, **ata):
        for k, v in ata.items():
            setattr(self, k, v)

a = WrapperC(
    indexes=x,
    geom = y
)
# ---------- end python_6 ----------
python_7 = GhPythonScript(x=cp.Points, y=evalsrf.Point)  # -> out, a; inputs x: list
# ---------- python_7: Python ----------
__author__ = "andrewastakhov"

import rhinoscriptsyntax as rs
x.append(y)
a=x
# ---------- end python_7 ----------
number_slider_4 = Slider(3, range=0..10)
merge = Merge(Data1=cp.Points)
end = EndPoints(Curve=item_4)  # -> Start, End
lscape = FitnessLandscape(Bounds=rec, Values=flatten(item_3.Item1), Count=-1, ColourMode=3, ContourMode=0, Remap=False)
merge_2 = Merge()
python_8 = GhPythonScript(x=pgroups.Indices, y=pgroups.Groups)  # -> out, a; inputs x: list, y: list; same code as python_6
sort_4 = SortList(Keys=lng_4, ValuesA=flatten(python_8.a))  # -> Keys, ValuesA
larger = LargerThan(FirstNumber=sort_4.Keys, SecondNumber=Slider(2, range=0..10))  # -> LargerThan, OrEqualTo
cull = CullPattern(List=sort_4.ValuesA, CullPattern=invert(larger.OrEqualTo))
panel_6 = Panel(item_2)
pt_10 = Point(bang.Branch0)
merge_3 = Merge(Data1=end.Start, Data2=end.End)
cull_2 = CullPattern(List=sort_4.ValuesA, CullPattern=larger.OrEqualTo)
crv_2 = Curve(bang.Branch3)
one_over_x_3 = OneOverX()
one_over_x_4 = OneOverX()
hops_6 = Hops(
    Pts=python_7.a,
    Run=True,
    CacheResultsInMemory=False,
    CacheSolveResults=False,
    RemoteDefinitionLocation="https://deephops.herokuapp.com/base_min_bound_rect ",
    RemoteSolveVersion=(0, 1, 0),
    ShowInput_Enabled=False,
    ShowInput_Path=False,
    SynchronousSolve=False)  # -> Out, A_pt_out
python_9 = GhPythonScript(x=cull)  # -> out, a
# ---------- python_9: Python ----------
__author__ = "andrewastakhov"

import rhinoscriptsyntax as rs

a = x.indexes
# ---------- end python_9 ----------
python_10 = GhPythonScript(x=cull_2)  # -> out, a; same code as python_9
item_5 = ListItem(List=pt_6, Index=python_10.a, Wrap=True)
demesh = DeconstructMesh(Mesh=lscape)  # -> Vertices, Faces, Colours, Normals
unflatten = UnflattenTree(Tree=demesh.Vertices, Guide=item_3.Item1)
tstat = TreeStatistics(Tree=simplify(unflatten))  # -> Paths, Length, Count
dpath = DeconstructPath(Branch=tstat.Paths)
num2pt = NumbersToPoints(Numbers=dpath, Mask=2)  # -> flatten(Points)
pdecon_2 = Deconstruct(Point=num2pt)  # -> XComponent, YComponent, ZComponent
merge_4 = Merge(Data1=flatten(one_over_x_3), Data2=flatten(one_over_x_4))
item_6 = ListItem(List=pt_6, Index=python_10.a, Wrap=True)
pt_11 = ConstructPoint(XCoordinate=pdecon_2.XComponent, YCoordinate=pdecon_2.YComponent, ZCoordinate=flatten(item_3.Item1))
pline_6 = PolyLine(Vertices=hops_6.A_pt_out, Closed=invert(False))
ln_2 = Line(StartPoint=merge_3)
item_7 = ListItem(List=explode_2.Segments, Index=python_10.a, Wrap=True)
pdecon_3 = Deconstruct()  # -> XComponent, YComponent, ZComponent
item_8 = ListItem(List=pt_6, Index=python_10.a, Wrap=True)
multiplication = Multiplication(A=merge_4)
python_11 = GhPythonScript(x=dpath, y=evalsrf.Point)  # -> out, a; inputs x: list; same code as python_7
partition = PartitionList(List=pt_11, Size=lng_2)
python_12 = GhPythonScript(x=item_8)  # -> out, a; inputs x: list of Point3d
# ---------- python_12: Python ----------
__author__ = "andrewastakhov"

import rhinoscriptsyntax as rs

import Rhino.Geometry as rg
from ghpythonlib.treehelpers import list_to_tree
from operator import add
import math



def sq(lst):
    return math.sqrt(reduce(add, [(i - reduce(add, lst)/len(lst))**2 for i in lst])/len(lst))
def sq_clc(x):
    for i in x:
        dist=[]
        for j in x:
            dist.append(i.DistanceTo(j))
        print(dist)
        yield sq(dist)

a = list_to_tree(list(sq_clc(x)))
# ---------- end python_12 ----------
ma = MassAddition(Input=multiplication)  # -> Result, PartialResults
pdecon_4 = Deconstruct(Point=partition)  # -> XComponent, YComponent, ZComponent
cpoly_2 = ControlPolygon(Curve=item_7)  # -> Polygon, Points
lng_5 = ListLength(List=merge_4)
sort_5 = SortList(Keys=pdecon_4.ZComponent, ValuesA=partition)  # -> reverse(Keys), reverse(ValuesA)
bnd = Bounds(Numbers=python_12.a)
trim = TrimTree(Tree=cpoly_2.Points, Depth=1)
graph_2 = GraphMapper(sort_5.Keys, x0=0, x1=1, y0=0, y1=1, Gx=0.5, Gy=0.7071067812, Ox=0, Oy=0, container_name="Square Root")
sort_6 = SortList(Keys=python_12.a)  # -> Keys, ValuesA
cp_2 = ControlPoints()  # -> Points, Weights, Knots
division = Division(A=ma.Result, B=lng_5)
sinc = Sinc(Value=sort_5.Keys)
remap = RemapNumbers(Value=python_12.a, Source=bnd, Target=Domain(0, 1))  # -> Mapped, Clipped
gradient = Gradient(LowerLimit=0, UpperLimit=1, Parameter=remap.Mapped, stops=[0: RGB(225, 255, 0), 1: RGB(0, 0, 255)])
group_2 = Group(Objects=item_8)
sort_7 = SortList(Keys=sort_5.ValuesA)  # -> Keys, ValuesA
split = SplitList(List=sort_5.ValuesA, Index=Slider(3, range=0..10))  # -> ListA, ListB
item_9 = ListItem(List=sort_5.ValuesA, Index=0, Wrap=True)
panel_7 = Panel(python_12.a)
area = Area()  # -> Area, Centroid
bang_2 = ExplodeTree(Data=item_7)  # -> Branch0, Branch1, Branch2, Branch3, Branch4, Branch5, Branch6, Branch7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
python_13 = GhPythonScript(x=multiplication)  # -> out, a, b; inputs x: list
# ---------- python_13: Python ----------
__author__ = "andrewastakhov"

import rhinoscriptsyntax as rs
from operator import add
import math
a= math.sqrt(reduce(add, [(i - reduce(add, x)/len(x))**2 for i in x])/len(x))
b= reduce(add, x)/len(x)
print a
# ---------- end python_13 ----------
round = Round(Number=graph_2)  # -> Nearest, Floor, Ceiling
equals = Equality(FirstNumber=round.Nearest, SecondNumber=1)  # -> Equality, Inequality
cull_3 = CullPattern(List=sort_5.ValuesA, CullPattern=equals.Equality)
bang_3 = ExplodeTree(Data=trim)  # -> Branch0, Branch1, Branch2, Branch3, Branch4, Branch5, Branch6, Branch7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
pt2num_2 = PointsToNumbers(Points=cull_3, Mask=2)
num2pt_2 = NumbersToPoints(Numbers=cull_3, Mask=4)
preview = CustomPreview(Geometry=flatten(item_7), Material=gradient)
cset = CreateSet(List=pt2num_2)  # -> Set, Map
item_10 = ListItem(List=explode_2.Segments, Index=cset.Set, Wrap=True)
hull = ConvexHull(Points=trim, Plane=PlaneXY(0, 0, 0))  # -> Hull, HullZ, Indices
panel_8 = Panel(remap.Mapped)
crv_3 = Curve(bang_3.Branch10)
panel_9 = Panel(item_10)
bang_4 = ExplodeTree(Data=item_10)  # -> _000000, _000010, _000020, _000030, _000040, _000050, _000060, _000070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
crv_4 = Curve(bang_4._0000280)
